# Grasshopper definition hot-clay-pen_print_example.gh (Grasshopper 1.0.8)
# plug-ins: Human

# ----
# EXTRUDING A PATH
number_slider = Slider(20, range=0..100)
crv = Curve(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)
len = Length(Curve=crv)
number_slider_2 = Slider(15, range=0..100)
division = Division(A=len, B=number_slider)
int = Integer(division)
divide = DivideCurve(Curve=crv, Count=int, Kinks=False)  # -> Points, Tangents, Parameters
divlength = DivideLength(Curve=crv, Length=Slider(20, range=0..100))  # -> Points, Tangents, Parameters
cls = Closed(Curve=crv)  # -> Closed, Periodic
Z = UnitZ(Factor=number_slider_2)
filter = StreamFilter(Gate=cls.Closed, Stream0=divlength.Points, Stream1=divide.Points)
move = Move(Geometry=filter, Motion=Z)  # -> Geometry, Transform
cull_i = CullIndex(List=move.Geometry, Indices="0", Wrap=True)
cull_i_2 = CullIndex(List=filter, Indices="-1", Wrap=True)
ln = Line(StartPoint=filter, EndPoint=move.Geometry)
ln_2 = Line(StartPoint=cull_i_2, EndPoint=cull_i)
pline = PolyLine(Vertices=filter, Closed=cls.Closed)
join = JoinCurves(Curves=flatten([ln, ln_2]), Preserve=False)
merge = Merge(Data1=flatten(pline), Data2=flatten(join))
series = Series(Start=0, Step=number_slider_2, Count=Slider(10, range=0..10))
group = Group(Objects=merge)
Z_2 = UnitZ(Factor=series)
move_2 = Move(Geometry=group, Motion=Z_2)  # -> Geometry, Transform
ungroup = Ungroup(Group=move_2.Geometry)  # -> flatten(Objects)
crv_2 = Curve(ungroup)

# ----
# SURFACE RECONSTRUCTION
crv_3 = Curve([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])
loft = Loft(Curves=crv_3, Options={Adjust=False, Closed=False, LoftEnds=0, LoftSimp=0, LoftType=0, Rebuild=10, Refit=0.01})
contour = Contour(Shape=loft, Point=Point(0, 0, 0), Direction=Vector(0, 0, 1), Distance=Slider(15, range=0..100))  # -> flatten(Contours)
len_2 = Length(Curve=contour)
division_2 = Division(A=len_2, B=Slider(19, range=0..100))
cull_i_3 = CullIndex(List=contour, Indices="0", Wrap=True)
cull_i_4 = CullIndex(List=contour, Indices="-1", Wrap=True)
int_2 = Integer(division_2)
avr = Average(Input=int_2)
divide_2 = DivideCurve(Curve=cull_i_4, Count=avr, Kinks=False)  # -> Points, Tangents, Parameters
divide_3 = DivideCurve(Curve=cull_i_3, Count=avr, Kinks=False)  # -> Points, Tangents, Parameters
pline_2 = PolyLine(Vertices=divide_2.Points, Closed=False)  # -> simplify(Polyline)
ln_3 = Line(StartPoint=divide_2.Points, EndPoint=divide_3.Points)
cull_i_5 = CullIndex(List=divide_3.Points, Indices="0", Wrap=True)
cull_i_6 = CullIndex(List=divide_2.Points, Indices="-1", Wrap=True)
ln_4 = Line(StartPoint=cull_i_6, EndPoint=cull_i_5)
merge_2 = Merge(Data1=simplify(ln_3), Data2=simplify(ln_4))
join_2 = JoinCurves(Curves=merge_2, Preserve=False)  # -> simplify(Curves)
merge_3 = Merge(Data1=pline_2, Data2=join_2)
explode = Explode(Curve=join_2, Recursive=True)  # -> Segments, Vertices

pt = Point(Point(0, 0, 1))
crv_4 = Curve(<curve referenced from the Rhino model>)
offset = Offset(Curve=crv_4, Distance=1, Plane=PlaneXY(0, 0, 0), Corners=1)
list = ValueList({"Cartesian": 0, "Delta": 1}, selected="Delta")
foam_printersetup_clay = Python3Script(PrinterType=list)  # -> out, Profile; inputs PrinterType: String, BedX: Double, BedY: Double, BedZ: Double, ExtrusionPressure: Double, FlowRate: Double, RetractionDelay: Double, CurePause: Double, FeedRate: Int32, ClearanceHeight: Double
#   port PrinterType: Select printer kinematics. Cartesian = rectangular bed, Delta = circular bed.
#   port BedRadius: if Delta, defaults to 150 radius
#   port BedX: Printer bed X dimension in mm. Default = 300.
#   port BedY: Printer bed Y dimension in mm. Default = 300.
#   port BedZ: Printer bed Z height in mm. Default = 300.
#   port ExtrusionPressure: Extrusion pressure in bar (or system equivalent). Default = 4.0.
#   port FlowRate: Material flow rate in ml/min (or relative units). Default = 10.0.
#   port RetractionDelay: Pause in seconds before resuming flow after retraction. Default = 0.5.
#   port CurePause: Optional pause in seconds for layer curing before next move. Default = 0.0.
#   port FeedRate: Feedrate for clay motion in mm/min. Default = 800.
#   port ClearanceHeight: Lift height in mm when moving between paths. Default = 5.
#   port Profile: Printer profile dictionary for FOAM_GcodeGenerator (Clay mode).
# ---------- foam_printersetup_clay: Python ----------
"""
FOAM_PrinterSetup_Clay
Creates a printer profile for paste/clay/concrete extrusion.
Supports Cartesian (rectangular bed) and Delta (circular bed) printers.
Outputs a dict that plugs into FOAM_GcodeGenerator.

Author: Luis Borunda
GitHub: https://github.com/lborunda/rhinoFOAM
License: MIT License

Cite: Hierarchical Structures, Free Oriented Additive Manufacturing (FOAM)
Borunda, L., & Anaya, R. (2022). Hierarchical structures: Computational design and digital 3D printing. Journal of the International Association for Shell and Spatial Structures, 64(1). https://doi.org/10.20898/j.iass.2022.015
L. Borunda, "rhinoFOAM," GitHub repository, 2025. [Online]. Available: https://github.com/lborunda/rhinoFOAM
"""

def make_clay_profile(printer_type="Cartesian",
                      bx=300, by=300, bz=300, radius=150,
                      pressure=4.0, flow=10.0, retract=0.5, cure=0.0,
                      fr=800, clr=5):
    
    if printer_type == "Delta":
        profile = {
            "Mode": "Clay",
            "PrinterType": "Delta",
            "BedRadius": radius,
            "BedZ": bz,
            "Params": {
                "ExtrusionPressure": pressure,
                "FlowRate": flow,
                "RetractionDelay": retract,
                "CurePause": cure,
                "FeedRate": fr,
                "ClearanceHeight": clr
            }
        }
    else:  # Cartesian (default)
        profile = {
            "Mode": "Clay",
            "PrinterType": "Cartesian",
            "BedX": bx,
            "BedY": by,
            "BedZ": bz,
            "Params": {
                "ExtrusionPressure": pressure,
                "FlowRate": flow,
                "RetractionDelay": retract,
                "CurePause": cure,
                "FeedRate": fr,
                "ClearanceHeight": clr
            }
        }
    return profile


# -----------------------------
# Grasshopper I/O
# -----------------------------
Profile = make_clay_profile(PrinterType, BedX, BedY, BedZ, BedRadius,
                            ExtrusionPressure, FlowRate, RetractionDelay,
                            CurePause, FeedRate, ClearanceHeight)
# ---------- end foam_printersetup_clay ----------
foam_printersetup_hot = Python3Script(PrinterType=list)  # -> out, Profile; inputs PrinterType: String, BedX: Double, BedY: Double, BedZ: Double, NozzleTemp: Int32, BedTemp: Int32, ExtrusionMultiplier: Double, FeedRate: Int32, ClearanceHeight: Double
#   port PrinterType: Select printer kinematics. Cartesian = rectangular bed, Delta = circular bed.
#   port BedRadius: if Delta, defaults to 150 radius
#   port BedX: Printer bed X dimension in mm. Default = 300.
#   port BedY: Printer bed Y dimension in mm. Default = 300.
#   port BedZ: Printer bed Z height in mm. Default = 300.
#   port NozzleTemp: Nozzle temperature in °C. Default = 210 (PLA).
#   port BedTemp: Bed temperature in °C. Default = 30.
#   port ExtrusionMultiplier: Multiplier for extrusion distance per mm moved. Default = 0.20.
#   port FeedRate: Feedrate for motion in mm/min. Default = 1500.
#   port ClearanceHeight: Lift height in mm when moving between paths. Default = 5.
#   port Profile: Printer profile dictionary for FOAM_GcodeGenerator (Hot mode).
# ---------- foam_printersetup_hot: Python ----------
"""
FOAM_PrinterSetup_Hot
Creates a printer profile for thermoplastic FDM printing.
Supports Cartesian (rectangular bed) and Delta (circular bed) printers.
Outputs a dict that plugs into FOAM_GcodeGenerator.

Author: Luis Borunda
GitHub: https://github.com/lborunda/rhinoFOAM
License: MIT License

Cite: Hierarchical Structures, Free Oriented Additive Manufacturing (FOAM)
Borunda, L., & Anaya, R. (2022). Hierarchical structures: Computational design and digital 3D printing. Journal of the International Association for Shell and Spatial Structures, 64(1). https://doi.org/10.20898/j.iass.2022.015
L. Borunda, "rhinoFOAM," GitHub repository, 2025. [Online]. Available: https://github.com/lborunda/rhinoFOAM
"""

def make_hot_profile(printer_type="Cartesian",
                     bx=300, by=300, bz=300, radius=150,
                     nozzle=210, bed=30, mult=0.20, fr=1500, clr=5):
    
    if printer_type == "Delta":
        profile = {
            "Mode": "Hot",
            "PrinterType": "Delta",
            "BedRadius": radius,
            "BedZ": bz,
            "Params": {
                "NozzleTemp": nozzle,
                "BedTemp": bed,
                "ExtrusionMultiplier": mult,
                "FeedRate": fr,
                "ClearanceHeight": clr
            }
        }
    else:  # Cartesian (default)
        profile = {
            "Mode": "Hot",
            "PrinterType": "Cartesian",
            "BedX": bx,
            "BedY": by,
            "BedZ": bz,
            "Params": {
                "NozzleTemp": nozzle,
                "BedTemp": bed,
                "ExtrusionMultiplier": mult,
                "FeedRate": fr,
                "ClearanceHeight": clr
            }
        }
    return profile


# -----------------------------
# Grasshopper I/O
# -----------------------------
Profile = make_hot_profile(PrinterType, BedX, BedY, BedZ,
                           BedRadius, NozzleTemp, BedTemp,
                           ExtrusionMultiplier, FeedRate, ClearanceHeight)
# ---------- end foam_printersetup_hot ----------
foam_printersetup_pen = Python3Script(PrinterType=list)  # -> out, Profile; inputs PrinterType: String, BedX: Double, BedY: Double, BedZ: Double, PenUpHeight: Double, PenDownOffset: Double, PenDownDelay: Double, FeedRate: Int32
#   port PrinterType: Select printer kinematics. Cartesian = rectangular bed, Delta = circular bed.
#   port BedRadius: if Delta, defaults to 150 radius
#   port BedX: Printer bed X dimension in mm. Default = 300.
#   port BedY: Printer bed Y dimension in mm. Default = 300.
#   port BedZ: Printer bed Z height in mm. Default = 300.
#   port PenUpHeight: Height offset (mm) when pen is lifted between paths. Default = 5.
#   port PenDownOffset: Z offset (mm) below path height when pen is touching the surface. Default = 0.2.
#   port PenDownDelay: Delay in ms after pen-down before moving. Default = 100.
#   port FeedRate: Feedrate for pen motion in mm/min. Default = 1000.
#   port Profile: Printer profile dictionary for FOAM_GcodeGenerator (Pen mode).
# ---------- foam_printersetup_pen: Python ----------
"""
FOAM_PrinterSetup_Pen
Creates a printer profile for pen-plotter or motion-only setups.
Supports Cartesian (rectangular bed) and Delta (circular bed) printers.
Outputs a dict that plugs into FOAM_GcodeGenerator.

Author: Luis Borunda
GitHub: https://github.com/lborunda/rhinoFOAM
License: MIT License

Cite: Hierarchical Structures, Free Oriented Additive Manufacturing (FOAM)
Borunda, L., & Anaya, R. (2022). Hierarchical structures: Computational design and digital 3D printing. Journal of the International Association for Shell and Spatial Structures, 64(1). https://doi.org/10.20898/j.iass.2022.015
L. Borunda, "rhinoFOAM," GitHub repository, 2025. [Online]. Available: https://github.com/lborunda/rhinoFOAM
"""

def make_pen_profile(printer_type="Cartesian",
                     bx=300, by=300, bz=300, radius=150,
                     up=5, down=0.2, delay=100, fr=1000):
    
    if printer_type == "Delta":
        profile = {
            "Mode": "Pen",
            "PrinterType": "Delta",
            "BedRadius": radius,
            "BedZ": bz,
            "Params": {
                "PenUpHeight": up,
                "PenDownOffset": down,
                "PenDownDelay": delay,
                "FeedRate": fr
            }
        }
    else:  # Cartesian (default)
        profile = {
            "Mode": "Pen",
            "PrinterType": "Cartesian",
            "BedX": bx,
            "BedY": by,
            "BedZ": bz,
            "Params": {
                "PenUpHeight": up,
                "PenDownOffset": down,
                "PenDownDelay": delay,
                "FeedRate": fr
            }
        }
    return profile


# -----------------------------
# Grasshopper I/O
# -----------------------------
Profile = make_pen_profile(PrinterType, BedX, BedY, BedZ, BedRadius,
                           PenUpHeight, PenDownOffset, PenDownDelay, FeedRate)
# ---------- end foam_printersetup_pen ----------
path = FilePath()

# ----
# SURFACE RECONSTRUCTION WITH ONE VOXEL THICKNESS
crv_5 = Curve([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])
loft_2 = Loft(Curves=crv_5, Options={Adjust=False, Closed=False, LoftEnds=0, LoftSimp=0, LoftType=0, Rebuild=10, Refit=0.01})
contour_2 = Contour(Shape=loft_2, Point=Point(0, 0, 0), Direction=Vector(0, 0, 1), Distance=Slider(10, range=0..100))  # -> flatten(Contours)
offset_2 = OffsetCurve(Curve=contour_2, Distance=Slider(37, range=0..100), Plane=PlaneXY(0, 0, 0), Corners=1)  # -> flatten(Curve)
cull_i_7 = CullIndex(List=offset_2, Indices="0", Wrap=True)
cull_i_8 = CullIndex(List=offset_2, Indices="-1", Wrap=True)
cull_i_9 = CullIndex(List=contour_2, Indices="0", Wrap=True)
cull_i_10 = CullIndex(List=contour_2, Indices="-1", Wrap=True)

# ----
# VOXEL (DISCRETIZING FREE FORM STRCUTURES)
number_slider_3 = Slider(19, range=0..100)
len_3 = Length(Curve=contour_2)
division_3 = Division(A=len_3, B=number_slider_3)
int_3 = Integer(division_3)
avr_2 = Average(Input=int_3)

divide_4 = DivideCurve(Curve=cull_i_7, Count=avr_2, Kinks=False)  # -> Points, Tangents, Parameters
divide_5 = DivideCurve(Curve=cull_i_8, Count=avr_2, Kinks=False)  # -> Points, Tangents, Parameters
divide_6 = DivideCurve(Curve=cull_i_9, Count=avr_2, Kinks=False)  # -> Points, Tangents, Parameters
divide_7 = DivideCurve(Curve=cull_i_10, Count=avr_2, Kinks=False)  # -> Points, Tangents, Parameters
cull_i_11 = CullIndex(List=divide_4.Points, Indices="-1", Wrap=True)
ln_5 = Line(StartPoint=divide_5.Points, EndPoint=divide_4.Points)
cull_i_12 = CullIndex(List=divide_6.Points, Indices="0", Wrap=True)
cull_i_13 = CullIndex(List=divide_7.Points, Indices="-1", Wrap=True)
cull_i_14 = CullIndex(List=divide_5.Points, Indices="0", Wrap=True)
pline_3 = PolyLine(Vertices=divide_4.Points, Closed=False)  # -> simplify(Polyline)
ln_6 = Line(StartPoint=cull_i_11, EndPoint=cull_i_14)
ln_7 = Line(StartPoint=divide_7.Points, EndPoint=divide_6.Points)
ln_8 = Line(StartPoint=cull_i_13, EndPoint=cull_i_12)
weave = Weave(Pattern=[0, 1], Stream0=divide_5.Points, Stream1=divide_6.Points, NullGaps=False)
weave_2 = Weave(Pattern=[0, 1], Stream0=divide_4.Points, Stream1=divide_6.Points, NullGaps=False)
merge_4 = Merge(Data1=simplify(ln_5), Data2=simplify(ln_6))
merge_5 = Merge(Data1=simplify(ln_7), Data2=simplify(ln_8))
pline_4 = PolyLine(Vertices=weave, Closed=False)
pline_5 = PolyLine(Vertices=weave_2, Closed=False)
flip = FlipCurve(Curve=pline_3)  # -> Curve, Flag
pline_6 = PolyLine(Vertices=divide_6.Points, Closed=False)  # -> simplify(Polyline)
join_3 = JoinCurves(Curves=merge_5, Preserve=False)  # -> simplify(Curves)
join_4 = JoinCurves(Curves=merge_4, Preserve=False)  # -> simplify(Curves)
flip_2 = FlipCurve(Curve=pline_4)  # -> Curve, Flag
merge_6 = Merge(
    Data1=simplify(join_3),
    Data2=simplify(pline_6),
    Data3=simplify(flip_2.Curve),
    Data4=simplify(join_4),
    Data5=simplify(flip.Curve),
    Data6=simplify(pline_5))  # -> flatten(Result)
explode_2 = Explode(Curve=merge_6, Recursive=True)  # -> flatten(Segments), Vertices
lng = ListLength(List=explode_2.Segments)
series_2 = Series(Start=0, Step=1, Count=lng)
gradient = Gradient(
    LowerLimit=0,
    UpperLimit=lng,
    Parameter=series_2,
    stops=[0: RGB(234, 38, 0), 0.25: RGB(234, 126, 0), 0.5: RGB(254, 244, 84), 0.75: RGB(173, 203, 249), 1: RGB(75, 107, 169)])
split = SplitList(List=explode_2.Segments, Index=Slider(869, range=0..1228))  # -> ListA, ListB
previewlw = CustomPreviewLineweights(Geometry=explode_2.Segments, Shader=gradient, Absolute=False)
crv_6 = Curve(split.ListA)

cluster = Cluster(C=crv_6)
curvepoint = PointOnCurve(cluster, parameter=0.5)
ln_9 = Line(StartPoint=curvepoint, EndPoint=pt)
move_3 = Move(Geometry=crv_6, Motion=ln_9)  # -> Geometry, Transform
merge_7 = Merge(Data1=crv_4, Data2=offset, Data3=move_3.Geometry)  # -> flatten(Result)
geo = Geometry(merge_7)
foam_gcodegenerator = Python3Script(Geometry=geo, Profile=foam_printersetup_hot.Profile)  # -> Gcode, PreviewText, Preview, Report, WarnDots, Bed; inputs Geometry: list of Polyline, BaseCode: String, FilePath: String
#   port Geometry: List of Polylines. Ordered by Z if 3D printing. Defines toolpaths.
#   port Profile: Printer profile dict from FOAM_PrinterSetup components. Optional (defaults to Pen mode). Three modes: "Hot", "Clay", "Pen".
#   port BaseCode: Optional: Custom header/footer G-code lines. If empty, defaults are used.
#   port FilePath: Optional: Save path for .gcode file. If empty, only outputs to Grasshopper.
#   port Gcode: Generated G-code program (list of strings). You can preview at https://ncviewer.com/
#   port PreviewText: just first 30 lines of Gcode (fast in GH)
#   port Preview: Polyline preview of toolpaths in Rhino.
#   port Report: Status/warnings (OK, geometry out of bed, Z<0, save error).
# ---------- foam_gcodegenerator: Python ----------
"""
FOAM_GcodeGenerator
Converts Rhino/Grasshopper polylines into G-code using FOAM principles.

Supports 3 modes:
  - "Hot"  (thermoplastic FDM, heated nozzle/bed)
  - "Clay" (concrete / paste extrusion, pressure-based)
  - "Pen"  (pen-plotter or cold motion, no extrusion)

Supports both Cartesian (BedX, BedY, BedZ) and Delta (BedRadius, BedZ) printers.

Author: Luis Borunda
GitHub: https://github.com/lborunda/rhinoFOAM
License: MIT License

Cite: Hierarchical Structures, Free Oriented Additive Manufacturing (FOAM)
Borunda, L., & Anaya, R. (2022). Hierarchical structures: Computational design and digital 3D printing. Journal of the International Association for Shell and Spatial Structures, 64(1). https://doi.org/10.20898/j.iass.2022.015
L. Borunda, "rhinoFOAM," GitHub repository, 2025. [Online]. Available: https://github.com/lborunda/rhinoFOAM


Inputs:
  Geometry   : Polylines or PolylineCurves (toolpaths, must be ordered by Z if 3D printing)
  Profile    : Printer profile dict (from FOAM_PrinterSetup components). Optional, defaults to Pen.
  BaseCode   : Optional list of strings with header/footer G-code. 
  FilePath   : Optional string path to save the G-code to disk.

Outputs:
  Gcode       : Full list of G-code strings (for saving/export)
  Preview     : Rhino polylines of the toolpath for visualization
  PreviewText : Short text preview of G-code (faster in GH)
  Report      : Status/warnings + debug info
  Bed         : Bed outline curve (rectangle or circle)
  BadPts      : Out-of-bounds points
  BadSegs     : Out-of-bounds segments
  WarnDots    : TextDots with warning messages
"""

import ast
import Rhino.Geometry as rg
from math import sqrt

# -----------------------------
# Helpers
# -----------------------------
def extract_points(pl):
    """Extracts Point3d coords from Polyline or PolylineCurve."""
    coords = []
    if isinstance(pl, rg.Polyline):
        coords = [rg.Point3d(round(pt.X,3), round(pt.Y,3), round(pt.Z,3)) for pt in pl]
    elif isinstance(pl, rg.PolylineCurve):
        success, poly = pl.TryGetPolyline()
        if success:
            coords = [rg.Point3d(round(pt.X,3), round(pt.Y,3), round(pt.Z,3)) for pt in poly]
    return coords

def in_bounds_cart(x, y, z, bx, by, bz):
    reasons = []
    if x < 0: reasons.append("X<0")
    if y < 0: reasons.append("Y<0")
    if z < 0: reasons.append("Z<0")
    if x > bx: reasons.append("X>BedX")
    if y > by: reasons.append("Y>BedY")
    if z > bz: reasons.append("Z>BedZ")
    return (len(reasons) == 0, reasons)

def in_bounds_delta(x, y, z, radius, bz):
    reasons = []
    r = sqrt(x*x + y*y)
    if r > radius: reasons.append("r>BedRadius")
    if z < 0: reasons.append("Z<0")
    if z > bz: reasons.append("Z>BedZ")
    return (len(reasons) == 0, reasons)


# -----------------------------
# Main
# -----------------------------
def generate_gcode(geometry, profile=None, base_code=None):
    # 1. Handle string profile input
    if isinstance(profile, str):
        try:
            profile = ast.literal_eval(profile)
        except:
            profile = None

    # 2. Defaults (Quickstart)
    mode = "Pen"
    printer_type = "Cartesian"
    bedX, bedY, bedZ = 300, 300, 300
    bedRadius = 150
    params = {}

    if profile and isinstance(profile, dict):
        mode = profile.get("Mode", "Pen")
        printer_type = profile.get("PrinterType", "Cartesian")
        bedX = profile.get("BedX", bedX)
        bedY = profile.get("BedY", bedY)
        bedZ = profile.get("BedZ", bedZ)
        bedRadius = profile.get("BedRadius", bedRadius)
        params = profile.get("Params", {})

    # 3. Safety checks
    status = "OK"
    preview_paths = []
    violations = 0
    BadPts, BadSegs, WarnDots = [], [], []
    Bed = None

    # Build Bed preview
    if printer_type == "Delta":
        Bed = rg.Circle(rg.Plane.WorldXY, bedRadius).ToNurbsCurve()
    else:
        rect = rg.Rectangle3d(rg.Plane.WorldXY, bedX, bedY)
        Bed = rect.ToNurbsCurve()

    if geometry:
        for pl in geometry:
            coords = extract_points(pl)
            if not coords: 
                continue

            # check each point
            for pt in coords:
                x, y, z = pt.X, pt.Y, pt.Z
                if printer_type == "Delta":
                    ok, reasons = in_bounds_delta(x, y, z, bedRadius, bedZ)
                else:
                    ok, reasons = in_bounds_cart(x, y, z, bedX, bedY, bedZ)
                if not ok:
                    violations += 1
                    BadPts.append(pt)
                    WarnDots.append(rg.TextDot(", ".join(reasons), pt))

            # flag bad segments
            for i in range(1, len(coords)):
                a, b = coords[i-1], coords[i]
                if a in BadPts or b in BadPts:
                    BadSegs.append(rg.LineCurve(a, b))

    if violations > 0:
        status = f"⚠ Out of bounds: {violations} point(s)"

        # balloon warning
        try:
            import Grasshopper as gh
            ghenv.Component.AddRuntimeMessage(
                gh.Kernel.GH_RuntimeMessageLevel.Warning, status
            )
        except:
            pass

    # 4. Base G-code header
    gcode = []
    if base_code:
        gcode.extend(base_code)
    else:
        gcode.append("; FOAM G-code Generator")
        gcode.append("G28 ; Home all axes")
        if mode == "Hot":
            gcode.append(f"M104 S{params.get('NozzleTemp', 210)} ; set nozzle temp")
            gcode.append(f"M140 S{params.get('BedTemp', 30)} ; set bed temp")
        gcode.append("G92 E0 ; Reset extrusion")

    # 5. Motion kernel
    extrusion = 0
    clearance = params.get("ClearanceHeight", 5)
    feedrate = params.get("FeedRate", 1500)

    for pl in geometry:
        coords = extract_points(pl)
        if not coords:
            continue

        # Preview polyline
        poly_prev = rg.Polyline()
        for pt in coords:
            poly_prev.Add(pt)
        preview_paths.append(poly_prev)

        # Generate G-code
        for j, pt in enumerate(coords):
            x, y, z = pt.X, pt.Y, pt.Z

            if j == 0:
                gcode.append(f"; Start path")
                gcode.append(f"G1 X{x} Y{y} Z{z+clearance} F2000 ; move above start")
                gcode.append(f"G1 X{x} Y{y} Z{z} F{feedrate} ; descend to start")
            else:
                dist = coords[j-1].DistanceTo(pt)
                if mode == "Hot":
                    extrusion += dist * params.get("ExtrusionMultiplier", 0.20)
                    gcode.append(f"G1 X{x} Y{y} Z{z} E{extrusion:.4f} F{feedrate}")
                else:  # Clay and Pen = no extrusion
                    gcode.append(f"G1 X{x} Y{y} Z{z} F{feedrate}")

            if j == len(coords)-1:
                gcode.append(f"; End path")
                gcode.append(f"G1 Z{z+clearance} F2000 ; lift tool")

    # 6. Footer
    gcode.append("; End of FOAM print")
    if mode == "Hot":
        gcode.append("M104 S0 ; turn off hotend")
        gcode.append("M140 S0 ; turn off bed")
    gcode.append("M107 ; fans off")
    gcode.append("G28 X0 ; home X")
    gcode.append("M84 ; disable motors")

    return gcode, preview_paths, status, Bed, BadPts, BadSegs, WarnDots


# -----------------------------
# Grasshopper IO
# -----------------------------
gcode, preview, status, Bed, BadPts, BadSegs, WarnDots = generate_gcode(Geometry, Profile, BaseCode)

# Full G-code (heavy, for saving)
Gcode = gcode      

# Short preview (first 30 lines only)
PreviewText = "\n".join(gcode[:30]) + f"\n... ({len(gcode)} lines total)" if gcode else "⚠ No G-code generated"

# Toolpath preview polylines
Preview = preview  

# Debug info
Report = f"Geometry: {len(Geometry) if Geometry else 0}, Paths: {len(preview)}, G-code lines: {len(gcode)}, Status: {status}"

# Visualization outputs
Bed = Bed
BadPts = BadPts
BadSegs = BadSegs
WarnDots = WarnDots

# Save to file if path provided
if FilePath:
    try:
        with open(FilePath, "w") as f:
            f.write("\n".join(gcode))
    except Exception as e:
        Report = f"⚠ Failed to save G-code: {e}"
# ---------- end foam_gcodegenerator ----------

# ==== cluster Cluster
C = ClusterInput()
bbox = BoundingBox(Content=C, Plane=PlaneXY(0, 0, 0), UnionBox=True)  # -> Box, Box_2
box_corners = BoxCorners(Box=bbox.Box)  # -> CornerA, CornerB, CornerC, CornerD, CornerE, CornerF, CornerG, CornerH
ln = Line(StartPoint=box_corners.CornerA, EndPoint=box_corners.CornerC)
L = ClusterOutput(ln)
